# Grasshopper definition Bento_MVP.gh (Grasshopper 1.0.7)
# plug-ins: Magnetizing_FPG, Human

# ----
# adjust these sliders
# set a point in rhino
number_slider = Slider(14, range=0..20)
point = Point(Point(6.350152412, 0.03920548355, 0))

# ----
# 1.Store layout sizing
xy_plane = XYPlane(Origin=Point(0, 0, 0))
rectangle = Rectangle(Plane=xy_plane, XSize=number_slider, YSize=Slider(7, range=0..20), Radius=0)  # -> Rectangle, Length
entrance_point = Point(point)
curve = Curve(rectangle.Rectangle)
boundary = Curve(curve)
area = Area(Geometry=curve)  # -> Area, Centroid
panel = Panel(area.Area)

# ----
# adjust these sliders as per portfolio category percentages
number_slider_2 = Slider(26.29, range=1..101)

# ----
# 2.Settings Store Portfolio percentage
# Time Square - Radius A
panel_2 = Panel(area.Area)
ghpython_script = GhPythonScript(
    store_area=panel_2,
    Billing_Counter_pct=Slider(5, range=0..100),
    beverage_relative_pct=number_slider_2,
    grab_and_go_relative_pct=Slider(22.53, range=0..100),
    frozen_food_relative_pct=Slider(9.21, range=0..100),
    household_supplies_relative_pct=Slider(11.95, range=0..100),
    coffee_service_relative_pct=Slider(0, range=0..100),
    seats_relative_pct=Slider(5, range=0..100),
    lunch_relative_pct=Slider(10, range=0..100),
    ice_cream_relative_pct=Slider(10, range=0..100),
    pick_up_lockers_relative_pct=Slider(0, range=0..100),
    baked_goods_relative_pct=Slider(0, range=0..100))  # -> output_text
# ---------- ghpython_script: Python ----------
# Inputs from Grasshopper sliders
store_area = float(store_area)  # Total store area
Billing_Counter_pct = float(Billing_Counter_pct)  # Percentage for billing counter

# Relative percentage sliders for each category and service
beverage_relative_pct = float(beverage_relative_pct)
grab_and_go_relative_pct = float(grab_and_go_relative_pct)
frozen_food_relative_pct = float(frozen_food_relative_pct)
household_supplies_relative_pct = float(household_supplies_relative_pct)

coffee_service_relative_pct = float(coffee_service_relative_pct)
seats_relative_pct = float(seats_relative_pct)
lunch_relative_pct = float(lunch_relative_pct)
ice_cream_relative_pct = float(ice_cream_relative_pct)
pick_up_lockers_relative_pct = float(pick_up_lockers_relative_pct)
baked_goods_relative_pct = float(baked_goods_relative_pct)

# Remaining percentage for categories and services after Billing_Counter_pct
remaining_pct = 100 - Billing_Counter_pct

# Function to calculate area based on percentage and round to the nearest whole number
def calculate_area(percentage, total_area):
    return round((percentage / 100) * total_area)

# Calculate billing counter area in square units
Billing_Counter_Area = calculate_area(Billing_Counter_pct, store_area)

# Calculate areas for Zone 1
Entrance_Lobby_Area = Billing_Counter_Area
Lunch_Area = calculate_area(lunch_relative_pct, store_area)
Ice_Cream_Area = calculate_area(ice_cream_relative_pct, store_area)
Pickup_Area = Lunch_Area + Ice_Cream_Area

# Calculate areas for each category based on remaining percentage
Beverage_Area = calculate_area((beverage_relative_pct / 100) * remaining_pct, store_area)
Grab_and_Go_Area = calculate_area((grab_and_go_relative_pct / 100) * remaining_pct, store_area)
Frozen_Food_Area = calculate_area((frozen_food_relative_pct / 100) * remaining_pct, store_area)
Household_Supplies_Area = calculate_area((household_supplies_relative_pct / 100) * remaining_pct, store_area)

# Calculate areas for each service based on remaining percentage
Coffee_Service_Area = calculate_area((coffee_service_relative_pct / 100) * remaining_pct, store_area)
Seats_Area = calculate_area((seats_relative_pct / 100) * remaining_pct, store_area)
Pick_Up_Lockers_Area = calculate_area((pick_up_lockers_relative_pct / 100) * remaining_pct, store_area)
Baked_Goods_Area = calculate_area((baked_goods_relative_pct / 100) * remaining_pct, store_area)

# Format the output as specified
output_text = (
    "ZONE 1:Entrance Lobby Area = {} sq.m\n"
    "  Billing Counter Area = {} sq.m\n\n"
    "ZONE 2:Pickup Area = {} sq.m\n"
    "  Lunch Area = {} sq.m\n"
    "  Ice Cream Area = {} sq.m\n\n"
    "ZONE 3:Cafe Area = {} sq.m\n"
    "  Coffee Service Area = {} sq.m\n"
    "  Baked Goods Area = {} sq.m\n"
    "  Seats Area = {} sq.m\n\n"
    "ZONE 4:Grocery Area = {} sq.m\n"
    "  Grab and Go Area = {} sq.m\n\n"
    "ZONE 5:Household Area = {} sq.m\n"
    "  Supplies Area = {} sq.m\n"
    "  Lockers Area = {} sq.m\n\n"
    "ZONE 6:Refrigeration Area = {} sq.m\n"
    "  Beverage Area = {} sq.m\n"
    "  Frozen Foods Area = {} sq.m\n"
).format(
    Entrance_Lobby_Area, Billing_Counter_Area,
    Pickup_Area, Lunch_Area, Ice_Cream_Area,
    Coffee_Service_Area + Baked_Goods_Area + Seats_Area, Coffee_Service_Area,
    Baked_Goods_Area, Seats_Area,
    Grab_and_Go_Area, Grab_and_Go_Area,
    Household_Supplies_Area + Pick_Up_Lockers_Area, Household_Supplies_Area, Pick_Up_Lockers_Area,
    Frozen_Food_Area + Beverage_Area, Beverage_Area, Frozen_Food_Area
)

# Output for Grasshopper - connect this to a Panel component to view the formatted list
output_text
# ---------- end ghpython_script ----------
panel_3 = Panel(ghpython_script)

# ----
# adjust the names,areas and adjacency diagram
roominstance = RoomInstance()
roominstance_2 = RoomInstance()
# 3.Creating adjacency
# layout for the store
roominstance_3 = RoomInstance()
roominstance_4 = RoomInstance()
roominstance_5 = RoomInstance()
roominstance_6 = RoomInstance()

# ----
# adjust these as per satisfaction
# connect the adjacency layout
# to this component
houseinstance = HouseInstance(Boundary=boundary, EntrancePoint=entrance_point)
iteration = Slider(300, range=1..400)

# ----
# 4.Generating rooms as per
# adjacency layout
setting = MagnetizingRooms_HeapES(HouseInstance=houseinstance, Iterations=iteration, MaxAdjDistance="6", CellSizeM=".6")  # -> Corridors, RoomBreps, RoomNames, Adjacencies, MissingAdjacences, Boundary, BoundaryOffset

# ---- group: List converting cluster
connections = Connections(T=setting.Adjacencies)

# ----
# play the button to start the forcefit
trigger = Timer(Interval=200, TimerInterval=200, Target=graph)
reset = Button()
rooms_boundary = Curve(simplify(setting.RoomBreps))
# 5.Forcefitting rooms within
# the store layout
boundary_2 = Curve(simplify(setting.Boundary))
graph = SpringSystem_ES(
    Boundary=boundary_2,
    Rooms=rooms_boundary,
    Adjacencies=connections,
    ProportionThreshold="2.2",
    FFBalance="1",
    SpringCollAllGenes=True,
    AdjustArea=Toggle(True),
    Reset=reset)  # -> Rooms, Adjacencies

text = Text(setting.RoomNames)
brep = Brep(setting.Corridors)
brep_2 = Brep(graph.Rooms)
text_2 = Text(graph.Adjacencies)
text_3 = Text(setting.MissingAdjacences)
curve_2 = Curve(boundary_2)
curve_3 = Curve(setting.BoundaryOffset)
cluster = Cluster_6(brep_2=brep, brep=brep_2, txt_2=text, txt=text_2, int=text_3, crv=curve_2, crv_2=curve_3)  # -> unsatisfied_categories, category_labels, category_boundary, category_surface, corridor_colours, corridor_surfaces, corridor_crvs, adjacency_crvs

# ----
# CATEGORY CURVES
number_slider_3 = Slider(0.05, range=0..4)
curve_4 = Curve(cluster.category_boundary)

# ----
# ADJACENCY CURVES
curve_5 = Curve(graph.Adjacencies)
thickness = Slider(0.05, range=0..10)
barva = ColourSwatch(SwatchColor=RGB(0, 0, 0))

# ----
# CATEGORY SURFACES
boundary_surfaces = BoundarySurfaces(Edges=curve_4)
text_4 = Text(cluster.corridor_colours)
surface = Surface(boundary_surfaces)

# ----
# UNSATISFIED CATEGORIES
number_slider_4 = Slider(4, range=0..4)
# 6.Extracting the exported layers of the layout
curve_6 = Curve(cluster.unsatisfied_categories)

# ---- group: Obvod
# STORE BOUNDARY
thickness_2 = Slider(0.139, range=0..10)
barva_2 = ColourSwatch(SwatchColor=RGB(0, 0, 0))
curve_7 = Curve(curve_2)

# ----
# ROOM NAMES
text_5 = Text(setting.RoomNames)
text_length = TextLength(Text=text_5)
minimum = Minimum(A="8", B=text_length)
text_fragment = TextFragment(Text=text_5, Start="0", Count=minimum)
match_text = MatchText(Text=text_fragment, Pattern="&&HALL&&", Case=True)
longest_list = LongestList(ListListA=match_text, ListListB="0", ListC="8", PaddingMode=2)  # -> ListListA, ListListB, ListC
pick_n_choose = PickNChoose(Pattern=match_text, Stream0=longest_list.ListListB, Stream1=longest_list.ListC)
text_fragment_2 = TextFragment(Text=text_5, Start=pick_n_choose)
area_2 = Area(Geometry=curve_4)  # -> Area, Centroid
text_6 = Text(text_fragment_2)

# ----
# check this
custom_preview_materials = CustomPreviewMaterials(Geometry=surface, DiffuseColor=text_4)

# ----
# check this
text_tag_3d = TextTag3D(Location=area_2.Centroid, Text=text_6, Size=".25", Colour=ColourSwatch(SwatchColor=RGB(0, 0, 0)), Justification=5)

# ----
# check this
custom_preview_lineweights = CustomPreviewLineweights(Geometry=curve_6, Shader=ColourSwatch(SwatchColor=RGB(255, 0, 0)), Thickness=number_slider_4, Absolute=False)

# ---- group: Obvod
# check this
custom_preview_lineweights_2 = CustomPreviewLineweights(Geometry=curve_7, Shader=barva_2, Thickness=thickness_2, Absolute=True)

# ----
# check this
custom_preview_lineweights_3 = CustomPreviewLineweights(Geometry=curve_4, Shader=ColourSwatch(SwatchColor=RGB(71, 71, 71)), Thickness=number_slider_3, Absolute=True)

# ----
# check this
appearancelines = CustomPreviewLineweights(Geometry=curve_5, Shader=barva, Thickness=thickness, Absolute=True)

python = GhPythonScript(file_name="room_data.txt")  # -> out, path
# ---------- python: Python ----------
import Rhino

local_folder = "/".join(ghenv.Component.OnPingDocument().FilePath.split("/")[:-1]) + "/"

path = local_folder + "static/" + file_name
# ---------- end python ----------
panel_4 = Panel(python.path)
file = ReadFile(File=python.path, PerLineParse=False)
python_2 = GhPythonScript(input_data=file)  # -> out, inputs
# ---------- python_2: Python ----------
import json

data = json.loads(input_data)

inputs = [float(data[key]) for key in ['room_x_range']]
# ---------- end python_2 ----------
panel_5 = Panel(python_2.inputs)
bang = ExplodeTree(Data=simplify(graft(python_2.inputs)))  # -> _0000, Branch1, Branch2

python_3 = GhPythonScript(file_name="config_data.txt")  # -> out, path; same code as python
panel_6 = Panel(python_3.path)
file_2 = ReadFile(File=python_3.path, PerLineParse=False)
python_4 = GhPythonScript(input_data=file_2)  # -> out, inputs
# ---------- python_4: Python ----------
import json

data = json.loads(input_data)

inputs = [float(data[key]) for key in ['config_x_range', 'config_y_range']]
# ---------- end python_4 ----------
panel_7 = Panel(python_4.inputs)
bang_2 = ExplodeTree(Data=simplify(graft(python_4.inputs)))  # -> Branch0, Branch1, Branch2

# ----
# adjust CORRIDOR WIDTH
narrow_corridor = Slider(1.2, range=0..3)

# ----
# adjust CORRIDOR WIDTH
narrow_corridor_2 = Slider(1.2, range=0..3)

# ----
# adjust RACK WIDTH
narrow_racks = Slider(0.6, range=0..3)

# ----
# adjust RACK WIDTH
narrow_racks_2 = Slider(0.6, range=0..3)

# ---- group: web-gh template
python_5 = GhPythonScript(file_name="inputs.txt")  # -> out, path
# ---------- python_5: Python ----------
import Rhino

local_folder = "\\".join(ghenv.Component.OnPingDocument().FilePath.split("\\")[:-1]) + "\\"

path = local_folder + "web-gh-main\\web-gh-main\\static\\" + file_name
# ---------- end python_5 ----------
panel_8 = Panel(python_5.path)
file_3 = ReadFile(File=python_5.path, PerLineParse=False)
panel_9 = Panel(file_3)
python_6 = GhPythonScript(input_data=file_3)  # -> out, inputs
# ---------- python_6: Python ----------
import json

data = json.loads(input_data)

inputs = [float(data[key]) for key in data.keys()]
# ---------- end python_6 ----------
bang_3 = ExplodeTree(Data=simplify(graft(python_6.inputs)))  # -> Branch0, Branch1, Branch2
pt = ConstructPoint(XCoordinate=bang_3.Branch0, YCoordinate=bang_3.Branch1, ZCoordinate=bang_3.Branch2)
pt_2 = ConstructPoint(XCoordinate=0, YCoordinate=0, ZCoordinate=0)
box = Box2Pt(PointA=pt_2, PointB=pt, Plane=PlaneXY(0, 0, 0))
python_7 = GhPythonScript(x=box, file_name="screenshot.jpg")  # -> out, a
# ---------- python_7: Python ----------
import Rhino

local_folder = "\\".join(ghenv.Component.OnPingDocument().FilePath.split("\\")[:-1]) + "\\"

file_path = local_folder + "web-gh-main\\web-gh-main\\static\\" + file_name

doc = Rhino.RhinoDoc.ActiveDoc
view = doc.Views.ActiveView

img = view.CaptureToBitmap()
img.Save(file_path)
# ---------- end python_7 ----------

# ----
# adjust slider to select room number
number_slider_5 = Slider(4, range=0..6)

# ----
# adjust slider to select room number
number_slider_6 = Slider(1, range=0..6)

# ----
# adjust these to get desired layout
rack_direction = ValueList({"Inward X dir Racks": 0, "Inward y dir Racks": 1, "Outward X dir Racks": 2, "Outward y dir Racks": 3}, selected="Inward X dir Racks")
edge_2 = ValueList({"No": "None", "Yes": 1}, selected="No")
edge_3 = ValueList({"No": "None", "Yes": 2}, selected="Yes")
edge_4 = ValueList({"No": "None", "Yes": 3}, selected="Yes")
edge_1 = ValueList({"No": "None", "Yes": 0}, selected="No")

# ----
# adjust these to get desired layout
rack_direction_2 = ValueList({"Inward X dir Racks": 0, "Inward y dir Racks": 1, "Outward X dir Racks": 2, "Outward y dir Racks": 3}, selected="Inward X dir Racks")
edge_2_2 = ValueList({"No": "None", "Yes": 1}, selected="Yes")
edge_3_2 = ValueList({"No": "None", "Yes": 2}, selected="No")
edge_4_2 = ValueList({"No": "None", "Yes": 3}, selected="Yes")
edge_1_2 = ValueList({"No": "None", "Yes": 0}, selected="Yes")

# ----
# 7.Developing rack layout for each room and the overall store
number = Number(bang_2.Branch1)
number_2 = Number(bang_2.Branch0)
curve_8 = Curve(curve_4)
list_item = ListItem(List=flatten(curve_8), Index=number_slider_6, Wrap=True)
curve_9 = Curve(list_item)
list_item_2 = ListItem(List=area_2.Centroid, Index=number_slider_6, Wrap=True)
list_item_3 = ListItem(List=text_5, Index=number_slider_6, Wrap=True)
cluster_2 = Cluster_5(
    list=curve_9,
    curve_number=number_slider_6,
    corridor_width=number_2,
    rack_width=number,
    edge_number=[edge_1_2, edge_2_2, edge_3_2, edge_4_2],
    parallel_racks_type=rack_direction_2)  # -> periphery_racks, corridor, parallel_racks
text_tag_3d_2 = TextTag3D(Location=list_item_2, Text=list_item_3, Size=".25", Justification=5)
curve_10 = Curve(cluster_2.corridor)
curve_11 = Curve(cluster_2.periphery_racks)
curve_12 = Curve(cluster_2.parallel_racks)
unit_z = UnitZ(Factor=Slider(2, range=0..10))
unit_z_2 = UnitZ(Factor=Slider(2, range=0..10))
extrude = Extrude(Base=curve_11, Direction=unit_z)
extrude_2 = Extrude(Base=curve_12, Direction=unit_z_2)

# ----
# baked these
cap_holes = CapHoles(Brep=extrude)
cap_holes_2 = CapHoles(Brep=extrude_2)

custom_preview = CustomPreview(Geometry=cap_holes, Material=ColourSwatch(SwatchColor=RGB(112, 112, 112)))
custom_preview_2 = CustomPreview(Geometry=cap_holes_2, Material=ColourSwatch(SwatchColor=RGB(204, 204, 204)))

python_8 = GhPythonScript(x=cap_holes, file_name="screenshot.jpg")  # -> out, a
# ---------- python_8: Python ----------
import Rhino

local_folder = "/".join(ghenv.Component.OnPingDocument().FilePath.split("/")[:-1]) + "/"

file_path = local_folder + "static/" + file_name

doc = Rhino.RhinoDoc.ActiveDoc
view = doc.Views.ActiveView

img = view.CaptureToBitmap()
img.Save(file_path)
# ---------- end python_8 ----------

# ----
# 7.Developing rack layout for each room and the overall store
number_3 = Number(bang_2.Branch0)
number_4 = Number(bang_2.Branch1)
curve_13 = Curve(curve_4)
list_item_4 = ListItem(List=flatten(curve_13), Index=number_slider_5, Wrap=True)
curve_14 = Curve(list_item_4)
list_item_5 = ListItem(List=area_2.Centroid, Index=number_slider_5, Wrap=True)
list_item_6 = ListItem(List=text_5, Index=number_slider_5, Wrap=True)
cluster_3 = Cluster_5(
    list=curve_14,
    curve_number=number_slider_5,
    corridor_width=number_3,
    rack_width=number_4,
    edge_number=[edge_1, edge_2, edge_3, edge_4],
    parallel_racks_type=rack_direction)  # -> periphery_racks, corridor, parallel_racks
text_tag_3d_3 = TextTag3D(Location=list_item_5, Text=list_item_6, Size=".25", Justification=5)
curve_15 = Curve(cluster_3.corridor)
curve_16 = Curve(cluster_3.periphery_racks)
curve_17 = Curve(cluster_3.parallel_racks)
unit_z_3 = UnitZ(Factor=Slider(2, range=0..10))
unit_z_4 = UnitZ(Factor=Slider(2, range=0..10))
extrude_3 = Extrude(Base=curve_16, Direction=unit_z_3)
extrude_4 = Extrude(Base=curve_17, Direction=unit_z_4)

# ----
# baked these
cap_holes_3 = CapHoles(Brep=extrude_3)
cap_holes_4 = CapHoles(Brep=extrude_4)

custom_preview_3 = CustomPreview(Geometry=cap_holes_3, Material=ColourSwatch(SwatchColor=RGB(112, 112, 112)))
custom_preview_4 = CustomPreview(Geometry=cap_holes_4, Material=ColourSwatch(SwatchColor=RGB(204, 204, 204)))

python_9 = GhPythonScript(x=cap_holes_3, file_name="screenshot.jpg")  # -> out, a; same code as python_7

# ==== cluster Connections
T = ClusterInput()
split = TextSplit(Text=T)
lng = ListLength(List=split)
subtraction = Subtraction(A=lng, B=2)
subset = SubList(List=simplify(split), Domain=subtraction, Wrap=True)  # -> List, Index
L = ClusterOutput(subset.List)

# ==== cluster Cluster_5
curve_number = ClusterInput()
list = ClusterInput()
corridor_width = ClusterInput()  # Corridor Width
rack_width = ClusterInput()  # Rack Width
edge_number = ClusterInput()
list_item = ListItem(List=list, Index=curve_number, Wrap=True)
curve = Curve(list_item)
explode = Explode(Curve=curve, Recursive=True)  # -> Segments, Vertices
parallel_racks_type = ClusterInput()

# ----
# CORRIDOR
negative = Negative(Value=corridor_width)

# ----
# PERIPHERY RACK
panel = Panel(edge_number)
periphery_rack = PeripheryRack(curve_exploded=explode.Segments, edge_number=panel, rack_width=rack_width)  # -> periphery_rack, offset_curve_2
join_curves = JoinCurves(Curves=periphery_rack.offset_curve_2, Preserve=False)

offset_curve = OffsetCurve(Curve=join_curves, Plane=PlaneXY(0, 0, 0), Distance=negative, BothSides=0, Kinks=0, CapType=1)
curve_2 = Curve(flatten(offset_curve))
join_curves_2 = JoinCurves(Curves=curve_2, Preserve=False)

offset_curve_2 = OffsetCurve(Curve=join_curves, Distance=negative, Corners=1)
curve_3 = Curve(flatten(offset_curve_2))

region_union = RegionUnion(Curves=[join_curves_2, periphery_rack.periphery_rack])

# ----
# X DIRECTION OUTWARD RACKS
cluster = Cluster(base_curve=curve, corridor_curve=region_union, rack_width=rack_width, corridor_width=corridor_width)

# ----
# Y DIRECTION OUTWARD RACKS
cluster_2 = Cluster_3(base_curve=curve, corridor_curve=region_union, rack_width=rack_width, corridor_width=corridor_width)

curve_4 = Curve(flatten(cluster))
curve_5 = Curve(flatten(cluster_2))
group = Group(Objects=curve_4)
group_2 = Group(Objects=curve_5)
periphery_racks = ClusterOutput(periphery_rack.periphery_rack)
corridor = ClusterOutput(join_curves_2)
curve_6 = Curve(join_curves)
explode_2 = Explode(Curve=curve_6, Recursive=True)  # -> Segments, Vertices
offset_curve_3 = OffsetCurve(Curve=explode_2.Segments, Distance=negative, Corners=1)
surface_split = SurfaceSplit(Surface=join_curves_2, Curves=flatten(offset_curve_3))
surface = Surface(surface_split)
list_item_2 = ListItem(List=surface, Index=Slider(0, range=0..1), Wrap=True)

# ----
# X DIRECTION INWARD RACKS
cluster_3 = Cluster_4(corridor_curve=list_item_2, rack_width=rack_width)

# ----
# Y DIRECTION INWARD RACKS
cluster_4 = Cluster_2(corridor_curve=list_item_2, rack_width=rack_width, corridor_width=corridor_width)

curve_7 = Curve(flatten(cluster_3))
curve_8 = Curve(flatten(cluster_4))
group_3 = Group(Objects=curve_7)
group_4 = Group(Objects=curve_8)
merge = Merge(Data1=group, Data2=group_2, Data3=group_3, Data4=group_4)
list_item_3 = ListItem(List=merge, Index=parallel_racks_type, Wrap=True)
ungroup = Ungroup(Group=list_item_3)
parallel_racks = ClusterOutput(ungroup)

# ==== cluster Cluster_6
crv = ClusterInput()
crv_2 = ClusterInput()
txt = ClusterInput()
txt_2 = ClusterInput()
brep = ClusterInput()
brep_2 = ClusterInput()
int = ClusterInput()

crv_3 = Curve(crv)
crv_4 = Curve(crv_2)

txt_3 = Text(txt)
txt_4 = Text(txt_2)
brep_3 = Brep(brep)
int_2 = Integer(int)
brep_4 = Brep(brep_2)

txt_5 = Text(txt_4)
len = TextLength(Text=txt_5)
min = Minimum(A="8", B=len)
fragment = TextFragment(Text=txt_5, Start="0", Count=min)
tmatch = MatchText(Text=fragment, Pattern="&&HALL&&", Case=True)
long = LongestList(ListA=tmatch, ListB="0", ListC="8", PaddingMode=2)  # -> ListA, ListB, ListC
p_n_c = PickNChoose(Pattern=tmatch, Stream0=long.ListB, Stream1=long.ListC)
fragment_2 = TextFragment(Text=txt_5, Start=p_n_c)

generation = Brep(brep_3)

# ---- group: Preview
trim = TextTrim(Text=txt_3, Start=True, End=True)
split = TextSplit(Text=trim, Separators="-,")
trim_2 = TextTrim(Text=split, Start=True, End=True)  # -> simplify(Result)
int_3 = Integer(split)
dispatch = Dispatch(List=int_3, DispatchPattern=[True, False])  # -> ListA, ListB
lng = ListLength(List=trim_2)  # -> expr("x-1", Length)
cull_i = CullIndex(List=trim_2, Indices=lng, Wrap=False)
item = ListItem(List=generation, Index=expr("x", dispatch.ListB), Wrap=True)
item_2 = ListItem(List=generation, Index=expr("x", dispatch.ListA), Wrap=True)
center = Center(Geometrical=item_2)  # -> Center, Dimension
center_2 = Center(Geometrical=item)  # -> Center, Dimension
ln = Line(StartPoint=center.Center, EndPoint=center_2.Center)
previewlw = CustomPreviewLineweights(Geometry=ln, Shader=ColourSwatch(SwatchColor=RGB(43, 43, 43)), Thickness=Slider(0.051, range=0..1), Absolute=True)

# ----
txt_6 = Text(fragment_2)

# ---- group: Perimeter preview
brep_5 = Brep(brep_4)
join = BrepJoin(Breps=flatten([brep_5, generation]))  # -> Breps, Closed
edges = BrepEdges(Brep=join.Breps)  # -> Naked, Interior, NonManifold
hsl = ColourHSL(Alpha=1, Hue=0, Saturation=0, Luminance=Slider(1, range=0..1))
crv_5 = Curve(edges.Naked)
number_slider = Slider(0.045, range=0..4)
previewmat = CustomPreviewMaterials(Geometry=brep_5, DiffuseColor=hsl)
join_2 = JoinCurves(Curves=crv_5, Preserve=False)
offset = Offset(Curve=flatten(join_2), Distance=expr("x/2", number_slider), Plane=PlaneXY(0, 0, 0), Corners=1)
previewlw_2 = CustomPreviewLineweights(Geometry=flatten(offset), Shader=ColourSwatch(SwatchColor=RGB(0, 0, 0)), Thickness=number_slider, Absolute=True)

# ----
join_3 = BrepJoin(Breps=flatten(brep_5))  # -> Breps, Closed
panel = Panel(txt_6)
edges_2 = BrepEdges(Brep=join_3.Breps)  # -> Naked, Interior, NonManifold

equals = Equality(FirstNumber=int_2, SecondNumber=0)  # -> Equality, Inequality
bbox = BoundingBox(Content=generation, Plane=PlaneXY(0, 0, 0))  # -> Box, Box_2
txt_7 = Text(fragment_2)
box_corners = BoxCorners(Box=bbox.Box)  # -> CornerA, CornerB, CornerC, CornerD, CornerE, CornerF, CornerG, CornerH
cull = CullPattern(List=generation, CullPattern=equals.Inequality)
panel_2 = Panel("IBM Plex Sans Condensed Medium")
center_3 = Center(Geometrical=cull)  # -> Center, Dimension
text = Text(Location=box_corners.CornerA, Size=".25", Font=panel_2)
text_2 = DefineText(Text=txt_7, Plane=box_corners.CornerA, Size=".25", Font=panel_2)
cir = Circle(Plane=center_3.Center, Radius=0.45)
boundary = BoundarySurfaces(Edges=cir)
center_4 = Center(Geometrical=generation)  # -> Center, Dimension
previewlw_3 = CustomPreviewLineweights(Geometry=boundary, Shader=ColourSwatch(SwatchColor=RGB(227, 0, 0)), Absolute=False)

# ---- group: Cluster Output
category_labels = ClusterOutput(panel)

# ----
crv_6 = Curve(edges_2.Naked)
text_tag_3d = TextTag3D(Location=center_4.Center, Text=txt_7, Size=".25", Colour=ColourSwatch(SwatchColor=RGB(0, 0, 0)), Justification=5)

# ---- group: Corridor crvs
adjacency_crvs = ClusterOutput(ln)

corridor_surfaces = ClusterOutput(brep_5)

# ----
corridor_crvs = ClusterOutput(crv_6)

# ---- group: Category Labels
category_surface = ClusterOutput(generation)

# ---- group: Cluster Output
unsatisfied_categories = ClusterOutput(boundary)

# ---- group: Preview_of_rooms
lng_2 = ListLength(List=generation)
crv_7 = Curve(simplify(generation))
division = Division(A=".8", B=lng_2)
series = Series(Start=0, Step=division, Count=lng_2)
addition = Addition(A=series, B=Slider(0.704, range=0..1))
long_2 = LongestList(ListA=tmatch, ListB=Slider(0.656, range=0..1), ListC="1", PaddingMode=2)  # -> ListA, ListB, ListC
p_n_c_2 = PickNChoose(Pattern=tmatch, Stream0=long_2.ListB, Stream1=long_2.ListC)
swatch = ColourSwatch(SwatchColor=RGB(71, 71, 71))
hsl_2 = ColourHSL(Alpha=1, Hue=addition, Saturation=1, Luminance=p_n_c_2)
previewmat_2 = CustomPreviewMaterials(Geometry=generation, DiffuseColor=hsl_2)

# ----
subtraction = Subtraction(A=hsl_2, B=swatch)  # -> simplify(Result)
panel_3 = Panel(hsl_2)

# ---- group: Preview_of_rooms (continued)
previewlw_4 = CustomPreviewLineweights(Geometry=crv_7, Shader=subtraction, Thickness=Slider(0.069, range=0..4), Absolute=True)

# ---- group: Cluster Output
corridor_colours = ClusterOutput(hsl_2)

# ---- group: Category Labels
category_boundary = ClusterOutput(crv_7)

# ==== cluster PeripheryRack
rack_width = ClusterInput()  # Rack Width
edge_number = ClusterInput()  # edge number
curve_exploded = ClusterInput()  # curve exploded
negative = Negative(Value=rack_width)
list_item = ListItem(List=curve_exploded, Index=edge_number, Wrap=True)
division = Division(A=negative, B="2")
join_curves = JoinCurves(Curves=list_item, Preserve=False)
offset_curve = OffsetCurve(Curve=join_curves, Distance=division, Plane=PlaneXY(0, 0, 0), Corners=1)
end_points = EndPoints(Curve=join_curves)  # -> Start, End
end_points_2 = EndPoints(Curve=offset_curve)  # -> Start, End
line = Line(StartPoint=end_points.Start, EndPoint=flatten(end_points_2.Start))
line_2 = Line(StartPoint=end_points.End, EndPoint=flatten(end_points_2.End))
curve = Curve(offset_curve)
curve_2 = Curve(line)
curve_3 = Curve(line_2)
curve_4 = Curve(join_curves)
join_curves_2 = JoinCurves(Curves=flatten([curve_4, curve_2, curve, curve_3]), Preserve=False)
periphery_rack = ClusterOutput(join_curves_2)  # Periphery Rack
offset_curve_2 = ClusterOutput(offset_curve)  # offset curve

# ==== cluster Cluster
corridor_width = ClusterInput()
rack_width = ClusterInput()
addition = Addition(A="0", B="2")

# ----
# X DIRECTION RACKS
corridor_curve = ClusterInput()
base_curve = ClusterInput()
region_difference = RegionDifference(CurvesA=base_curve, CurvesB=corridor_curve)
curve = Curve(region_difference)
explode = Explode(Curve=curve, Recursive=True)  # -> Segments, Vertices
panel = Panel(corridor_width)
panel_2 = Panel(rack_width)
list_item = ListItem(List=explode.Segments, Index="0", Wrap=True)
list_item_2 = ListItem(List=explode.Segments, Index=addition, Wrap=True)
length = Length(Curve=list_item)  # -> flatten(Length)
panel_3 = Panel(length)
ghpython_script = GhPythonScript(rack_width=panel_2, corridor_width=panel, curve_length=panel_3)  # -> out, divisions, used_length, remaining_length
# ---------- ghpython_script: Python ----------
def calculate_rack_divisions(rack_width, corridor_width, curve_length):
    """
    Calculate the number of racks that can fit in the given curve length.

    Parameters:
    - rack_width (float): Width of a single rack.
    - corridor_width (float): Width of the corridor between racks.
    - curve_length (float): Total length of the curve to be analyzed.

    Returns:
    - divisions (int): Number of racks that can fit.
    - used_length (float): Total length used by the racks and corridors.
    - remaining_length (float): Unused portion of the curve length.
    """

    # Initialize the division count and cumulative length
    divisions = 1
    cumulative_length = (rack_width / 2) + corridor_width + (rack_width / 2)

    # Check how many racks and corridors fit
    while cumulative_length <= curve_length:
        divisions += 1
        cumulative_length += rack_width + corridor_width

    # Calculate used and remaining lengths
    used_length = cumulative_length - (rack_width + corridor_width)
    remaining_length = curve_length - used_length

    # Round the outputs for cleaner results
    used_length = round(used_length, 2)
    remaining_length = round(remaining_length, 2)

    return divisions, used_length, remaining_length


# Ensure inputs are floats
rack_width = float(rack_width)         # Convert input to float
corridor_width = float(corridor_width) # Convert input to float
curve_length = float(curve_length)     # Convert input to float

# Calculate outputs
divisions, used_length, remaining_length = calculate_rack_divisions(rack_width, corridor_width, curve_length)

# Assign outputs to Grasshopper
a = divisions          # Number of racks
b = used_length        # Total length used
c = remaining_length   # Remaining length
# ---------- end ghpython_script ----------
panel_4 = Panel(ghpython_script.divisions)
panel_5 = Panel(ghpython_script.used_length)
panel_6 = Panel(ghpython_script.remaining_length)
flip_curve = FlipCurve(Curve=list_item_2)  # -> Curve, Flag
subtraction = Subtraction(A=panel_4, B="1")
divide_curve = DivideCurve(Curve=list_item, Count=subtraction, Kinks=False)  # -> Points, Tangents, Parameters
divide_curve_2 = DivideCurve(Curve=flip_curve.Curve, Count=subtraction, Kinks=False)  # -> Points, Tangents, Parameters
list_item_3 = ListItem(List=divide_curve_2.Points, Index="0", Wrap=True)
cull_index = CullIndex(List=divide_curve_2.Points, Indices=["0", "-1"], Wrap=True)
list_item_4 = ListItem(List=divide_curve_2.Points, Index="-1", Wrap=True)
list_item_5 = ListItem(List=divide_curve.Points, Index="0", Wrap=True)
cull_index_2 = CullIndex(List=divide_curve.Points, Indices=["0", "-1"], Wrap=True)
list_item_6 = ListItem(List=divide_curve.Points, Index="-1", Wrap=True)
line = Line(StartPoint=list_item_6, EndPoint=list_item_4)
line_2 = Line(StartPoint=cull_index_2, EndPoint=cull_index)
line_3 = Line(StartPoint=list_item_5, EndPoint=list_item_3)

value_list = ValueList({"Double loaded": 1, "Single loaded": 2}, selected="Single loaded")
negative = Negative(Value=rack_width)
curve_2 = Curve(line_2)
division = Division(A=negative, B=value_list)
negative_2 = Negative(Value=division)
offset_curve = OffsetCurve(Curve=curve_2, Plane=PlaneXY(0, 0, 0), Distance=division, BothSides=negative_2, Kinks=0, CapType=1)

value_list_2 = ValueList({"Double loaded": 1, "Single loaded": 2}, selected="Single loaded")
negative_3 = Negative(Value=rack_width)
curve_3 = Curve(line)
division_2 = Division(A=negative_3, B=value_list_2)
offset_curve_2 = OffsetCurve(Curve=curve_3, Plane=PlaneXY(0, 0, 0), Distance=division_2, BothSides=0, Kinks=0, CapType=1)

value_list_3 = ValueList({"Double loaded": 1, "Single loaded": 2}, selected="Single loaded")
curve_4 = Curve(line_3)
negative_4 = Negative(Value=rack_width)
division_3 = Division(A=negative_4, B=value_list_3)

flip_curve_2 = FlipCurve(Curve=curve_4)  # -> Curve, Flag

offset_curve_3 = OffsetCurve(Curve=flip_curve_2.Curve, Plane=PlaneXY(0, 0, 0), Distance=division_3, BothSides=0, Kinks=0, CapType=1)

merge = Merge(Data1=offset_curve_2, Data2=offset_curve, Data3=offset_curve_3)
outward_racks = ClusterOutput(merge)

# ==== cluster Cluster_2
corridor_width = ClusterInput()
addition = Addition(A="0", B="2")
rack_width = ClusterInput()

# ----
# X DIRECTION RACKS
corridor_curve = ClusterInput()
curve = Curve(corridor_curve)
explode = Explode(Curve=curve, Recursive=True)  # -> Segments, Vertices
panel = Panel(corridor_width)
panel_2 = Panel(rack_width)
list_item = ListItem(List=explode.Segments, Index="0", Wrap=True)
list_item_2 = ListItem(List=explode.Segments, Index=addition, Wrap=True)
length = Length(Curve=list_item)  # -> flatten(Length)
panel_3 = Panel(length)
ghpython_script = GhPythonScript(rack_width=panel_2, corridor_width=panel, curve_length=panel_3)  # -> out, divisions, used_length, remaining_length; same code as ghpython_script
panel_4 = Panel(ghpython_script.divisions)
panel_5 = Panel(ghpython_script.used_length)
panel_6 = Panel(ghpython_script.remaining_length)
flip_curve = FlipCurve(Curve=list_item_2)  # -> Curve, Flag
subtraction = Subtraction(A=panel_4, B="1")
divide_curve = DivideCurve(Curve=list_item, Count=subtraction, Kinks=False)  # -> Points, Tangents, Parameters
divide_curve_2 = DivideCurve(Curve=flip_curve.Curve, Count=subtraction, Kinks=False)  # -> Points, Tangents, Parameters
list_item_3 = ListItem(List=divide_curve_2.Points, Index="0", Wrap=True)
cull_index = CullIndex(List=divide_curve_2.Points, Indices=["0", "-1"], Wrap=True)
list_item_4 = ListItem(List=divide_curve_2.Points, Index="-1", Wrap=True)
list_item_5 = ListItem(List=divide_curve.Points, Index="0", Wrap=True)
cull_index_2 = CullIndex(List=divide_curve.Points, Indices=["0", "-1"], Wrap=True)
list_item_6 = ListItem(List=divide_curve.Points, Index="-1", Wrap=True)
line = Line(StartPoint=list_item_6, EndPoint=list_item_4)
line_2 = Line(StartPoint=cull_index_2, EndPoint=cull_index)
line_3 = Line(StartPoint=list_item_5, EndPoint=list_item_3)

value_list = ValueList({"Double loaded": 1, "Single loaded": 2}, selected="Single loaded")
negative = Negative(Value=rack_width)
curve_2 = Curve(line_2)
division = Division(A=negative, B=value_list)
negative_2 = Negative(Value=division)
offset_curve = OffsetCurve(Curve=curve_2, Plane=PlaneXY(0, 0, 0), Distance=division, BothSides=negative_2, Kinks=0, CapType=1)

value_list_2 = ValueList({"Double loaded": 1, "Single loaded": 2}, selected="Single loaded")
negative_3 = Negative(Value=rack_width)
curve_3 = Curve(line)
division_2 = Division(A=negative_3, B=value_list_2)
offset_curve_2 = OffsetCurve(Curve=curve_3, Plane=PlaneXY(0, 0, 0), Distance=division_2, BothSides=0, Kinks=0, CapType=1)

value_list_3 = ValueList({"Double loaded": 1, "Single loaded": 2}, selected="Single loaded")
curve_4 = Curve(line_3)
negative_4 = Negative(Value=rack_width)
division_3 = Division(A=negative_4, B=value_list_3)

flip_curve_2 = FlipCurve(Curve=curve_4)  # -> Curve, Flag

offset_curve_3 = OffsetCurve(Curve=flip_curve_2.Curve, Plane=PlaneXY(0, 0, 0), Distance=division_3, BothSides=0, Kinks=0, CapType=1)

merge = Merge(Data1=offset_curve_2, Data2=offset_curve, Data3=offset_curve_3)
in_ward_racks = ClusterOutput(merge)

# ==== cluster Cluster_3
corridor_width = ClusterInput()
rack_width = ClusterInput()
addition = Addition(A="1", B="2")

# ----
# Y DIRECTION RACKS
corridor_curve = ClusterInput()
base_curve = ClusterInput()
region_difference = RegionDifference(CurvesA=base_curve, CurvesB=corridor_curve)
curve = Curve(region_difference)
explode = Explode(Curve=curve, Recursive=True)  # -> Segments, Vertices
panel = Panel(rack_width)
list_item = ListItem(List=explode.Segments, Index="1", Wrap=True)
list_item_2 = ListItem(List=explode.Segments, Index=addition, Wrap=True)
length = Length(Curve=list_item)  # -> flatten(Length)
panel_2 = Panel(length)
ghpython_script = GhPythonScript(rack_width=panel, corridor_width=corridor_width, curve_length=panel_2)  # -> out, divisions, used_length, remaining_length; same code as ghpython_script
panel_3 = Panel(ghpython_script.divisions)
panel_4 = Panel(ghpython_script.used_length)
panel_5 = Panel(ghpython_script.remaining_length)
flip_curve = FlipCurve(Curve=list_item_2)  # -> Curve, Flag
subtraction = Subtraction(A=panel_3, B="1")
divide_curve = DivideCurve(Curve=list_item, Count=subtraction, Kinks=False)  # -> Points, Tangents, Parameters
divide_curve_2 = DivideCurve(Curve=flip_curve.Curve, Count=subtraction, Kinks=False)  # -> Points, Tangents, Parameters
list_item_3 = ListItem(List=divide_curve_2.Points, Index="0", Wrap=True)
cull_index = CullIndex(List=divide_curve_2.Points, Indices=["0", "-1"], Wrap=True)
list_item_4 = ListItem(List=divide_curve_2.Points, Index="-1", Wrap=True)
list_item_5 = ListItem(List=divide_curve.Points, Index="0", Wrap=True)
cull_index_2 = CullIndex(List=divide_curve.Points, Indices=["0", "-1"], Wrap=True)
list_item_6 = ListItem(List=divide_curve.Points, Index="-1", Wrap=True)
line = Line(StartPoint=list_item_6, EndPoint=list_item_4)
line_2 = Line(StartPoint=cull_index_2, EndPoint=cull_index)
line_3 = Line(StartPoint=list_item_5, EndPoint=list_item_3)

value_list = ValueList({"Double loaded": 1, "Single loaded": 2}, selected="Single loaded")
negative = Negative(Value=rack_width)
curve_2 = Curve(line_2)
division = Division(A=negative, B=value_list)
negative_2 = Negative(Value=division)
offset_curve = OffsetCurve(Curve=curve_2, Plane=PlaneXY(0, 0, 0), Distance=division, BothSides=negative_2, Kinks=0, CapType=1)

value_list_2 = ValueList({"Double loaded": 1, "Single loaded": 2}, selected="Single loaded")
negative_3 = Negative(Value=rack_width)
curve_3 = Curve(line)
division_2 = Division(A=negative_3, B=value_list_2)
offset_curve_2 = OffsetCurve(Curve=curve_3, Plane=PlaneXY(0, 0, 0), Distance=division_2, BothSides=0, Kinks=0, CapType=1)

value_list_3 = ValueList({"Double loaded": 1, "Single loaded": 2}, selected="Single loaded")
curve_4 = Curve(line_3)
negative_4 = Negative(Value=rack_width)
division_3 = Division(A=negative_4, B=value_list_3)

flip_curve_2 = FlipCurve(Curve=curve_4)  # -> Curve, Flag

offset_curve_3 = OffsetCurve(Curve=flip_curve_2.Curve, Plane=PlaneXY(0, 0, 0), Distance=division_3, BothSides=0, Kinks=0, CapType=1)

merge = Merge(Data1=offset_curve_2, Data2=offset_curve, Data3=offset_curve_3)
outward_racks = ClusterOutput(merge)

# ==== cluster Cluster_4
addition = Addition(A="1", B="2")
rack_width = ClusterInput()

# ----
# Y DIRECTION RACKS
corridor_curve = ClusterInput()
curve = Curve(corridor_curve)
explode = Explode(Curve=curve, Recursive=True)  # -> Segments, Vertices
panel = Panel(rack_width)
list_item = ListItem(List=explode.Segments, Index="1", Wrap=True)
list_item_2 = ListItem(List=explode.Segments, Index=addition, Wrap=True)
length = Length(Curve=list_item)  # -> flatten(Length)
panel_2 = Panel(length)
ghpython_script = GhPythonScript(rack_width=panel, corridor_width="1.2", curve_length=panel_2)  # -> out, divisions, used_length, remaining_length; same code as ghpython_script
panel_3 = Panel(ghpython_script.divisions)
panel_4 = Panel(ghpython_script.used_length)
panel_5 = Panel(ghpython_script.remaining_length)
flip_curve = FlipCurve(Curve=list_item_2)  # -> Curve, Flag
subtraction = Subtraction(A=panel_3, B="1")
divide_curve = DivideCurve(Curve=list_item, Count=subtraction, Kinks=False)  # -> Points, Tangents, Parameters
divide_curve_2 = DivideCurve(Curve=flip_curve.Curve, Count=subtraction, Kinks=False)  # -> Points, Tangents, Parameters
list_item_3 = ListItem(List=divide_curve_2.Points, Index="0", Wrap=True)
cull_index = CullIndex(List=divide_curve_2.Points, Indices=["0", "-1"], Wrap=True)
list_item_4 = ListItem(List=divide_curve_2.Points, Index="-1", Wrap=True)
list_item_5 = ListItem(List=divide_curve.Points, Index="0", Wrap=True)
cull_index_2 = CullIndex(List=divide_curve.Points, Indices=["0", "-1"], Wrap=True)
list_item_6 = ListItem(List=divide_curve.Points, Index="-1", Wrap=True)
line = Line(StartPoint=list_item_6, EndPoint=list_item_4)
line_2 = Line(StartPoint=cull_index_2, EndPoint=cull_index)
line_3 = Line(StartPoint=list_item_5, EndPoint=list_item_3)

value_list = ValueList({"Double loaded": 1, "Single loaded": 2}, selected="Single loaded")
negative = Negative(Value=rack_width)
curve_2 = Curve(line_2)
division = Division(A=negative, B=value_list)
negative_2 = Negative(Value=division)
offset_curve = OffsetCurve(Curve=curve_2, Plane=PlaneXY(0, 0, 0), Distance=division, BothSides=negative_2, Kinks=0, CapType=1)

value_list_2 = ValueList({"Double loaded": 1, "Single loaded": 2}, selected="Single loaded")
negative_3 = Negative(Value=rack_width)
curve_3 = Curve(line)
division_2 = Division(A=negative_3, B=value_list_2)
offset_curve_2 = OffsetCurve(Curve=curve_3, Plane=PlaneXY(0, 0, 0), Distance=division_2, BothSides=0, Kinks=0, CapType=1)

value_list_3 = ValueList({"Double loaded": 1, "Single loaded": 2}, selected="Single loaded")
curve_4 = Curve(line_3)
negative_4 = Negative(Value=rack_width)
division_3 = Division(A=negative_4, B=value_list_3)

flip_curve_2 = FlipCurve(Curve=curve_4)  # -> Curve, Flag

offset_curve_3 = OffsetCurve(Curve=flip_curve_2.Curve, Plane=PlaneXY(0, 0, 0), Distance=division_3, BothSides=0, Kinks=0, CapType=1)

merge = Merge(Data1=offset_curve_2, Data2=offset_curve, Data3=offset_curve_3)
in_ward_racks = ClusterOutput(merge)
