# Grasshopper definition model.gh (Grasshopper 1.0.7)

python = GhPythonScript(file_name="inputs.txt")  # -> out, path
# ---------- python: Python ----------
import Rhino

local_folder = "/".join(ghenv.Component.OnPingDocument().FilePath.split("/")[:-1]) + "/"

path = local_folder + "static/" + file_name
# ---------- end python ----------
panel = Panel(python.path)
file = ReadFile(File=python.path, PerLineParse=False)
python_2 = GhPythonScript(input_data=file)  # -> out, inputs
# ---------- python_2: Python ----------
import json

data = json.loads(input_data)

inputs = [float(data[key]) for key in data.keys()]
# ---------- end python_2 ----------
bang = ExplodeTree(Data=simplify(graft(python_2.inputs)))  # -> Branch0, Branch1, Branch2
pt = ConstructPoint(XCoordinate=bang.Branch0, YCoordinate=bang.Branch1, ZCoordinate=bang.Branch2)
pt_2 = ConstructPoint(XCoordinate=0, YCoordinate=0, ZCoordinate=0)
box = Box2Pt(PointA=pt_2, PointB=pt, Plane=PlaneXY(0, 0, 0))
python_3 = GhPythonScript(x=box, file_name="screenshot.jpg")  # -> out, a
# ---------- python_3: Python ----------
import Rhino

local_folder = "/".join(ghenv.Component.OnPingDocument().FilePath.split("/")[:-1]) + "/"

file_path = local_folder + "static/" + file_name

doc = Rhino.RhinoDoc.ActiveDoc
view = doc.Views.ActiveView

img = view.CaptureToBitmap()
img.Save(file_path)
# ---------- end python_3 ----------
